# Grasshopper definition surface-evaluation.ghx

srf = Surface(flatten(<surface referenced from the Rhino model>))
area = Area(Geometry=srf)  # -> Area, Centroid
srf_cp = SurfaceClosestPoint(Point=area.Centroid, Surface=srf)  # -> Point, UVPoint, Distance
evalsrf = EvaluateSurface(Surface=simplify(graft(srf)), Point=srf_cp.UVPoint)  # -> Point, Normal, UDirection, VDirection, Frame

num = Number(expr("x/2", area.Area))
